# Grasshopper definition Points_from_GH_V00..gh (Grasshopper 1.0.7)
# plug-ins: Bifocals

point = Point([Point(-11.68456076, 25.03805233, 0), Point(-11.68456076, 25.03805233, 0), Point(-11.68456076, 25.03805233, 0), Point(16.15139409, 6.969099175, 0), Point(-21.36912639, -7.821376333, 0), Point(-1.429208976, -20.86685568, 0)])
nurbs_curve = NurbsCurve(Vertices=point, Degree=3, Periodic=False)  # -> Curve, Length, Domain
divide_curve = DivideCurve(Curve=nurbs_curve.Curve, Count=10, Kinks=False)  # -> Points, Tangents, Parameters
deconstruct = Deconstruct(Point=divide_curve.Points)  # -> XComponent, YComponent, ZComponent
list_item = ListItem(List=deconstruct.YComponent, Index=0, Wrap=True)
list_item_2 = ListItem(List=deconstruct.XComponent, Index=0, Wrap=True)
subtraction = Subtraction(A=deconstruct.YComponent, B=list_item)
subtraction_2 = Subtraction(A=deconstruct.XComponent, B=list_item_2)
points_to_numbers = PointsToNumbers(Points=divide_curve.Points, Mask=4)
construct_point = ConstructPoint(XCoordinate=subtraction_2, YCoordinate=subtraction, ZCoordinate=deconstruct.ZComponent)
panel = Panel(points_to_numbers)
panel_2 = Panel(divide_curve.Points)
